% Requirement links of HLF_SystemArchitecture.slx (R2021b)

block :169 Allocate TSRS.slreqx#95: SYS_HLF#7.4: Lane Boundary detection
block :186 Allocate TSRS.slreqx#56: SYS_HLF#7.1: Detection of lead car
block :188 Allocate TSRS.slreqx#19: SYS_HLF#5: HLF Driver Interface
block :188 Allocate TSRS.slreqx#21: SYS_HLF#5.2: Target Speed Selection
block :188 Allocate TSRS.slreqx#29: SYS_HLF#5.2.1: Set Button Usage
block :188 Allocate TSRS.slreqx#30: SYS_HLF#5.2.2: Increment Button Usage
block :188 Allocate TSRS.slreqx#31: SYS_HLF#5.2.3: Decrement Button Usage
block :188 Allocate TSRS.slreqx#32: SYS_HLF#5.2.4: Resume Button Usage
block :188 Allocate TSRS.slreqx#33: SYS_HLF#5.2.5: Brake Pedal Usage
block :188 Allocate TSRS.slreqx#22: SYS_HLF#5.3: Driver Displays
block :188 Allocate TSRS.slreqx#34: SYS_HLF#5.3.1: Off Mode Status
block :188 Allocate TSRS.slreqx#35: SYS_HLF#5.3.2: Standby Mode Status
block :188 Allocate TSRS.slreqx#36: SYS_HLF#5.3.3: Active Mode - Speed Control Status
block :188 Allocate TSRS.slreqx#37: SYS_HLF#5.3.4: Active Mode - Following Control Status
block :188 Allocate TSRS.slreqx#38: SYS_HLF#5.3.5: Target Speed Display - Not Set
block :188 Allocate TSRS.slreqx#41: SYS_HLF#5.3.6: Target Speed Display - Standby Mode
block :188 Allocate TSRS.slreqx#39: SYS_HLF#5.3.7: Target Speed Display - Speed Control Mode
block :188 Allocate TSRS.slreqx#40: SYS_HLF#5.3.8: Target Speed Display - Following Control Mode
block :238 Allocate TSRS.slreqx#78: SYS_HLF#7.2: Leading Vehicle Discrimination
block :238 Allocate TSRS.slreqx#97: SYS_HLF#7.3: Attributes of the leading vehicle
block :238 Allocate TSRS.slreqx#42: SYS_HLF#6.1: Operational Limits
block :238 Allocate TSRS.slreqx#23: SYS_HLF#6.2: Speed Control Performance
block :238 Allocate TSRS.slreqx#24: SYS_HLF#6.3: Following Control Performance
block :238 Allocate TSRS.slreqx#43: SYS_HLF#6.1.1: Minimum Target Speed
block :238 Allocate TSRS.slreqx#44: SYS_HLF#6.1.2: Minimum Operating Speed
block :238 Allocate TSRS.slreqx#45: SYS_HLF#6.1.3: Maximum Target Speed
block :238 Allocate TSRS.slreqx#46: SYS_HLF#6.1.4: Maximum Acceleration
block :238 Allocate TSRS.slreqx#47: SYS_HLF#6.1.5: Maximum Deceleration
block :238 Allocate TSRS.slreqx#48: SYS_HLF#6.1.6: Maximum Rate of Change of Deceleration
block :238 Allocate TSRS.slreqx#83: SYS_HLF#6.1.8: Minimum steering angle
block :238 Allocate TSRS.slreqx#84: SYS_HLF#6.1.9: Maximum steering Angle
block :238 Allocate TSRS.slreqx#53: SYS_HLF#6.3.1: Minimum Time Gap
block :238 Allocate TSRS.slreqx#54: SYS_HLF#6.3.2: Minimum Clearance
block :238 Allocate TSRS.slreqx#55: SYS_HLF#6.3.3: Transient Conditions and Collision Avoidance
block :238 Allocate TSRS.slreqx#20: SYS_HLF#6: HLF Performance Requirements
block :238 Allocate TSRS.slreqx#1
block :238 Allocate TSRS.slreqx#2
block :238 Allocate TSRS.slreqx#6
block :238 Allocate TSRS.slreqx#7
block :238 Allocate TSRS.slreqx#3
block :238 Allocate TSRS.slreqx#8
block :238 Allocate TSRS.slreqx#9
block :238 Allocate TSRS.slreqx#10
block :238 Allocate TSRS.slreqx#11
block :238 Allocate TSRS.slreqx#4
block :238 Allocate TSRS.slreqx#12
block :238 Allocate TSRS.slreqx#13
block :238 Allocate TSRS.slreqx#14
block :238 Allocate TSRS.slreqx#15
block :238 Allocate TSRS.slreqx#5
block :238 Allocate TSRS.slreqx#16
block :238 Allocate TSRS.slreqx#17
block :238 Allocate TSRS.slreqx#18