% Simulink data dictionary DD_HLF_Configuration.sldd

Ts = 0.1
LaneWidth = single(3.6)
HalfLaneWidth = single(1.8)
PredictionHorizon = single(30)
PredictionTimeSteps = single([0; 0.1; 0.2; 0.3; 0.4; 0.5; 0.6; 0.7; 0.8; 0.9; 1; 1.1; 1.2; 1.3; 1.4; 1.5; 1.6; 1.7; 1.8; 1.9; 2; 2.1; 2.2; 2.3; 2.4; 2.5; 2.6; 2.7; 2.8; 2.9; 3])
PredictionNumSteps = 31
posSelector = [1 0 0 0 0 0; 0 0 1 0 0 0]
velSelector = [0 1 0 0 0 0; 0 0 0 1 0 0]
LaneCurveParams_Max = single([0.06 0.15 0.6 0.5])
LaneCurveParams_Min = single([-0.06 -0.15 -0.6 -0.5])