% Simulink data dictionary DD_PFC_Configuration.sldd

tau = 0.5
time_gap = 1.5
default_spacing = 10
max_ac = 2
min_ac = -3
max_steer = 0.26
min_steer = -0.26
tau2 = 0.07
max_dc = -10
mioIgnoreDistanceThreshold = 1000
mioIgnoreRelDistance = 200
mioIgnoreVelocity = 0
longVelUlimit = 100
longVelLlimit = 1.0e-5