% Simulink data dictionary DD_HLF_DataTypes.sldd

BusMultiObjectTrackerTracks = Simulink.Bus()
  TrackID: uint32
  BranchID: uint32
  SourceIndex: uint32
  UpdateTime: double
  Age: uint32
  State: double[6 1]
  StateCovariance: double[6 6]
  ObjectClassID: double
  TrackLogic: Enum: trackLogicType
  TrackLogicState: boolean[1 5]
  IsConfirmed: boolean
  IsCoasted: boolean
  IsSelfReported: boolean
  ObjectAttributes: Bus: BusRadarDetectionsObjectAttributes[2 1]

BusMultiObjectTracker = Simulink.Bus()
  NumTracks: double
  Tracks: Bus: BusMultiObjectTrackerTracks[100 1]

BusRadarDetectionsObjectAttributes = Simulink.Bus()
  TargetIndex: double
  SNR: double

BusLaneCenter = Simulink.Bus()
  Curvature: single
  CurvatureDerivative: single
  HeadingAngle: single
  LateralOffset: single

LaneSensorBoundaries = Simulink.Bus()  % Describes sensor structure interface for lane boundaries from lane sensor
  Curvature: single, Unit="rad/m"
  CurvatureDerivative: single, Unit="rad/m^2"
  HeadingAngle: single, Unit="rad"
  LateralOffset: single, Unit="m"
  Strength: single
  XExtent: single[1 2]
  BoundaryType: Enum: LaneBoundaryType

LaneSensor = Simulink.Bus()  % Describes sensor structure interface for lane sensor
  Left: Bus: LaneSensorBoundaries
  Right: Bus: LaneSensorBoundaries

BusVehiclePose = Simulink.Bus()
  ActorID: double
  Position: double[1 3]
  Velocity: double[1 3]
  Roll: double
  Pitch: double
  Yaw: double
  AngularVelocity: double[1 3]

Distance_DType = "double"
Distance_Min = []
Distance_Max = []
Distance_Dimensions = 1
Distance_Complexity = "real"
Distance_Unit = "m"
Velocity_DType = "double"
Velocity_Min = []
Velocity_Max = []
Velocity_Dimensions = 1
Velocity_Complexity = "real"
Velocity_Unit = "m/s"
Steering_DType = "double"
Steering_Min = []
Steering_Max = []
Steering_Dimensions = 1
Steering_Complexity = "real"
Steering_Unit = "rad"
Acceleration_DType = "double"
Acceleration_Min = []
Acceleration_Max = []
Acceleration_Dimensions = 1
Acceleration_Complexity = "real"
Acceleration_Unit = "m/s^2"