% Requirement links of DD_HLF_DataTypes.sldd (R2021b)

item 1 relates to SSRS.slreqx#64: SW_HLF#4.2: Detected Traffic Participants
item 2 relates to SSRS.slreqx#64: SW_HLF#4.2: Detected Traffic Participants
item 3 relates to SSRS.slreqx#67: SW_HLF#4.1: Lanes Information
item 4 relates to SSRS.slreqx#67: SW_HLF#4.1: Lanes Information
item 5 relates to SSRS.slreqx#53: SW_HLF#5.1.1: Lane Centerline
item 6 relates to SSRS.slreqx#64: SW_HLF#4.2: Detected Traffic Participants