% Simulink data dictionary DD_HLF_WDG_DataTypes.sldd

TTC_DType = "double"
TTC_Min = []
TTC_Max = []
TTC_Dimensions = 1
TTC_Complexity = "real"
TTC_Unit = "s"
StopTime_DType = "double"
StopTime_Min = 0
StopTime_Max = 40
StopTime_Dimensions = 1
StopTime_Complexity = "real"
StopTime_Unit = "s"
BrStatus_Enum = "Enum: BrStatus"
BrStatus_Dimensions = 1
BrStatus_Complexity = "real"
BrStatus_Unit = []