% Requirement links of EstimateLaneCenter.slx (R2021b)

block :19 implements SSRS.slreqx#67: SW_HLF#4.1: Lanes Information
block :20 implements SSRS.slreqx#71: Estimate Lane Center from Left Boundaries
block :40 implements SSRS.slreqx#70: Estimate Lane Center from Left and Right Boundaries
block :61 implements SSRS.slreqx#73: Estimate Lane Center without reliable lane boundary detections
block :65 implements SSRS.slreqx#72: Estimate Lane Center from Right Boundaries only
block :91 implements SSRS.slreqx#53: SW_HLF#5.1.1: Lane Centerline