% Requirement links of FindLeadCar.slx (R2021b)

model implements SSRS.slreqx#55: SSR 3.1: Identification of leading car
model implements SSRS.slreqx#56: SSR 3.2: Information about Leading Car
block :19 implements SSRS.slreqx#64: SW_HLF#4.2: Detected Traffic Participants
block :20 implements SSRS.slreqx#67: SW_HLF#4.1: Lanes Information