% Requirement links of MPCController.slx (R2021b)

model implements SSRS.slreqx#91: Vehicle Model
model implements SSRS.slreqx#90: Default spacing
model implements SSRS.slreqx#92: Operational Limits
block :26 implements SSRS.slreqx#82: SW_HLF#7.1.3: Time Gap
block :40 implements SSRS.slreqx#81: MPC Path Following Controller
block :40 implements SSRS.slreqx#100: SW_HLF#7.1.4.4: Vehicle dynamics model
block :43 implements SSRS.slreqx#80: Leading Vehicle Limiters
block :43 implements SSRS.slreqx#83: Longitudinal Velocity Limiters