% Requirement links of WDGBrakingLogic.slx (R2021b)

model implements SSRS.slreqx#99: Stopped Vehicle
block :29 implements SSRS.slreqx#94: Driver warning
block :29 implements SSRS.slreqx#95: Partial Braking Level 1
block :29 implements SSRS.slreqx#96: Partial Braking Level 2
block :29 implements SSRS.slreqx#97: Full Braking
block :29 implements SSRS.slreqx#98: Idle state