test file "ControllerModeSelector_Test"
  coverage: Decision, MCDC, SignalRange

suite "requirements_based_tests"

  case "TC1" [baseline]
    model ControllerModeSelector, harness ControllerModeSelector_Harness, mode Normal
    input "ReqInputData.mat", mapped to mpc_acceleration -> Acceleration, braking_switch -> WatchdogBrake, wdg_deceleration -> Deceleration (active)
    baseline "ReqBaseline.mat"
      braking_switch
      AccelerationCmd:1

suite "interface_tests"

  case "TC1" [baseline]
    model ControllerModeSelector, harness ControllerModeSelector_Harness
    configuration set: csMultiInstanceInterface from csMultiInstanceInterface.mat
    input "InterfaceInputData.mat", mapped to mpc_acceleration -> Acceleration, braking_switch -> WatchdogBrake, wdg_deceleration -> Deceleration (active)
    baseline "InterfaceBaseline.mat"
      braking_switch
      AccelerationCmd:1

suite "fault_injection_tests" (disabled)

  case "TC1" [baseline] (disabled)
    model ControllerModeSelector

suite "resource_usage_tests" (disabled)

  case "TC1" [baseline] (disabled)
    model ControllerModeSelector