test file "LaneCenterCoordChange_Test"
  coverage: Decision, MCDC, SignalRange

suite "requirements_based_tests"

  case "TC1" [baseline]
    model LaneCenterCoordChange

suite "interface_tests"

  case "TC1" [baseline]
    model LaneCenterCoordChange

suite "fault_injection_tests"

  case "TC1" [baseline]
    model LaneCenterCoordChange

suite "resource_usage_tests"

  case "TC1" [baseline]
    model LaneCenterCoordChange

suite "MIL-SIL back2back tests"

  case "TC1" [baseline]
    model LaneCenterCoordChange

suite "MIL-PIL back2back tests"

  case "TC1" [baseline]
    model LaneCenterCoordChange