test file "WDGBrakingLogic_SLDV_Based_Test"
  coverage: Decision, MCDC, SignalRange, SimulinkDesignVerifier, RelationalBoundary, Condition, LookupTable, SaturationOnIntOverflow

suite "SLDV-Based Test"

  case "LLR_SLDV" [baseline]
    description: Simulation test for LLR from SLDV.
    model WDGBrakingLogic, harness WDGBrakingLogic_Harness_SLDV
    input "Test Case:1" from WDGBrakingLogic_sldvdata.mat (active)
    input "Test Case:2" from WDGBrakingLogic_sldvdata.mat
    input "Test Case:3" from WDGBrakingLogic_sldvdata.mat
    input "Test Case:4" from WDGBrakingLogic_sldvdata.mat
    input "Test Case:5" from WDGBrakingLogic_sldvdata.mat
    input "Test Case:6" from WDGBrakingLogic_sldvdata.mat
    input "Test Case:7" from WDGBrakingLogic_sldvdata.mat
    input "Test Case:8" from WDGBrakingLogic_sldvdata.mat
    input "Test Case:9" from WDGBrakingLogic_sldvdata.mat
    input "Test Case:10" from WDGBrakingLogic_sldvdata.mat
    input "Test Case:11" from WDGBrakingLogic_sldvdata.mat
    input "Test Case:12" from WDGBrakingLogic_sldvdata.mat
    input "Test Case:13" from WDGBrakingLogic_sldvdata.mat
    input "Test Case:14" from WDGBrakingLogic_sldvdata.mat
    input "Test Case:15" from WDGBrakingLogic_sldvdata.mat
    input "Test Case:16" from WDGBrakingLogic_sldvdata.mat
    input "Test Case:17" from WDGBrakingLogic_sldvdata.mat
    input "Test Case:18" from WDGBrakingLogic_sldvdata.mat
    input "Test Case:19" from WDGBrakingLogic_sldvdata.mat
    input "Test Case:20" from WDGBrakingLogic_sldvdata.mat
    input "Test Case:21" from WDGBrakingLogic_sldvdata.mat
    input "Test Case:22" from WDGBrakingLogic_sldvdata.mat
    input "Test Case:23" from WDGBrakingLogic_sldvdata.mat
    input "Test Case:24" from WDGBrakingLogic_sldvdata.mat
    input "Test Case:25" from WDGBrakingLogic_sldvdata.mat
    input "Test Case:26" from WDGBrakingLogic_sldvdata.mat
    input "Test Case:27" from WDGBrakingLogic_sldvdata.mat
    input "Test Case:28" from WDGBrakingLogic_sldvdata.mat
    input "Test Case:29" from WDGBrakingLogic_sldvdata.mat
    input "Test Case:30" from WDGBrakingLogic_sldvdata.mat
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    baseline "TestCases_1.mat": abs tol 1e-06, rel tol 0.001
      BrakeStatus:1
      decel:1
    baseline "TestCases_10.mat": abs tol 1e-06, rel tol 0.001
      BrakeStatus:1
      decel:1
    baseline "TestCases_11.mat": abs tol 1e-06, rel tol 0.001
      BrakeStatus:1
      decel:1
    baseline "TestCases_12.mat": abs tol 1e-06, rel tol 0.001
      BrakeStatus:1
      decel:1
    baseline "TestCases_13.mat": abs tol 1e-06, rel tol 0.001
      BrakeStatus:1
      decel:1
    baseline "TestCases_14.mat": abs tol 1e-06, rel tol 0.001
      BrakeStatus:1
      decel:1
    baseline "TestCases_15.mat": abs tol 1e-06, rel tol 0.001
      BrakeStatus:1
      decel:1
    baseline "TestCases_16.mat": abs tol 1e-06, rel tol 0.001
      BrakeStatus:1
      decel:1
    baseline "TestCases_17.mat": abs tol 1e-06, rel tol 0.001
      BrakeStatus:1
      decel:1
    baseline "TestCases_18.mat": abs tol 1e-06, rel tol 0.001
      BrakeStatus:1
      decel:1
    baseline "TestCases_19.mat": abs tol 1e-06, rel tol 0.001
      BrakeStatus:1
      decel:1
    baseline "TestCases_2.mat": abs tol 1e-06, rel tol 0.001
      BrakeStatus:1
      decel:1
    baseline "TestCases_20.mat": abs tol 1e-06, rel tol 0.001
      BrakeStatus:1
      decel:1
    baseline "TestCases_21.mat": abs tol 1e-06, rel tol 0.001
      BrakeStatus:1
      decel:1
    baseline "TestCases_22.mat": abs tol 1e-06, rel tol 0.001
      BrakeStatus:1
      decel:1
    baseline "TestCases_23.mat": abs tol 1e-06, rel tol 0.001
      BrakeStatus:1
      decel:1
    baseline "TestCases_24.mat": abs tol 1e-06, rel tol 0.001
      BrakeStatus:1
      decel:1
    baseline "TestCases_25.mat": abs tol 1e-06, rel tol 0.001
      BrakeStatus:1
      decel:1
    baseline "TestCases_26.mat": abs tol 1e-06, rel tol 0.001
      BrakeStatus:1
      decel:1
    baseline "TestCases_27.mat": abs tol 1e-06, rel tol 0.001
      BrakeStatus:1
      decel:1
    baseline "TestCases_28.mat": abs tol 1e-06, rel tol 0.001
      BrakeStatus:1
      decel:1
    baseline "TestCases_29.mat": abs tol 1e-06, rel tol 0.001
      BrakeStatus:1
      decel:1
    baseline "TestCases_3.mat": abs tol 1e-06, rel tol 0.001
      BrakeStatus:1
      decel:1
    baseline "TestCases_30.mat": abs tol 1e-06, rel tol 0.001
      BrakeStatus:1
      decel:1
    baseline "TestCases_31.mat": abs tol 1e-06, rel tol 0.001
      BrakeStatus:1
      decel:1
    baseline "TestCases_32.mat": abs tol 1e-06, rel tol 0.001
      BrakeStatus:1
      decel:1
    baseline "TestCases_33.mat": abs tol 1e-06, rel tol 0.001
      BrakeStatus:1
      decel:1
    baseline "TestCases_34.mat": abs tol 1e-06, rel tol 0.001
      BrakeStatus:1
      decel:1
    baseline "TestCases_35.mat": abs tol 1e-06, rel tol 0.001
      BrakeStatus:1
      decel:1
    baseline "TestCases_36.mat": abs tol 1e-06, rel tol 0.001
      BrakeStatus:1
      decel:1
    baseline "TestCases_37.mat": abs tol 1e-06, rel tol 0.001
      BrakeStatus:1
      decel:1
    baseline "TestCases_38.mat": abs tol 1e-06, rel tol 0.001
      BrakeStatus:1
      decel:1
    baseline "TestCases_39.mat": abs tol 1e-06, rel tol 0.001
      BrakeStatus:1
      decel:1
    baseline "TestCases_4.mat": abs tol 1e-06, rel tol 0.001
      BrakeStatus:1
      decel:1
    baseline "TestCases_40.mat": abs tol 1e-06, rel tol 0.001
      BrakeStatus:1
      decel:1
    baseline "TestCases_41.mat": abs tol 1e-06, rel tol 0.001
      BrakeStatus:1
      decel:1
    baseline "TestCases_42.mat": abs tol 1e-06, rel tol 0.001
      BrakeStatus:1
      decel:1
    baseline "TestCases_43.mat": abs tol 1e-06, rel tol 0.001
      BrakeStatus:1
      decel:1
    baseline "TestCases_44.mat": abs tol 1e-06, rel tol 0.001
      BrakeStatus:1
      decel:1
    baseline "TestCases_45.mat": abs tol 1e-06, rel tol 0.001
      BrakeStatus:1
      decel:1
    baseline "TestCases_46.mat": abs tol 1e-06, rel tol 0.001
      BrakeStatus:1
      decel:1
    baseline "TestCases_47.mat": abs tol 1e-06, rel tol 0.001
      BrakeStatus:1
      decel:1
    baseline "TestCases_48.mat": abs tol 1e-06, rel tol 0.001
      BrakeStatus:1
      decel:1
    baseline "TestCases_49.mat": abs tol 1e-06, rel tol 0.001
      BrakeStatus:1
      decel:1
    baseline "TestCases_5.mat": abs tol 1e-06, rel tol 0.001
      BrakeStatus:1
      decel:1
    baseline "TestCases_50.mat": abs tol 1e-06, rel tol 0.001
      BrakeStatus:1
      decel:1
    baseline "TestCases_51.mat": abs tol 1e-06, rel tol 0.001
      BrakeStatus:1
      decel:1
    baseline "TestCases_52.mat": abs tol 1e-06, rel tol 0.001
      BrakeStatus:1
      decel:1
    baseline "TestCases_53.mat": abs tol 1e-06, rel tol 0.001
      BrakeStatus:1
      decel:1
    baseline "TestCases_6.mat": abs tol 1e-06, rel tol 0.001
      BrakeStatus:1
      decel:1
    baseline "TestCases_7.mat": abs tol 1e-06, rel tol 0.001
      BrakeStatus:1
      decel:1
    baseline "TestCases_8.mat": abs tol 1e-06, rel tol 0.001
      BrakeStatus:1
      decel:1
    baseline "TestCases_9.mat": abs tol 1e-06, rel tol 0.001
      BrakeStatus:1
      decel:1
    iterations:
      Test Case:1: ExternalInput "Test Case:1", Baseline "TestCases_1.mat"
      Test Case:2: ExternalInput "Test Case:2", Baseline "TestCases_2.mat"
      Test Case:3: ExternalInput "Test Case:3", Baseline "TestCases_3.mat"
      Test Case:4: ExternalInput "Test Case:4", Baseline "TestCases_4.mat"
      Test Case:5: ExternalInput "Test Case:5", Baseline "TestCases_5.mat"
      Test Case:6: ExternalInput "Test Case:6", Baseline "TestCases_6.mat"
      Test Case:7: ExternalInput "Test Case:7", Baseline "TestCases_7.mat"
      Test Case:8: ExternalInput "Test Case:8", Baseline "TestCases_8.mat"
      Test Case:9: ExternalInput "Test Case:9", Baseline "TestCases_9.mat"
      Test Case:10: ExternalInput "Test Case:10", Baseline "TestCases_10.mat"
      Test Case:11: ExternalInput "Test Case:11", Baseline "TestCases_11.mat"
      Test Case:12: ExternalInput "Test Case:12", Baseline "TestCases_12.mat"
      Test Case:13: ExternalInput "Test Case:13", Baseline "TestCases_13.mat"
      Test Case:14: ExternalInput "Test Case:14", Baseline "TestCases_14.mat"
      Test Case:15: ExternalInput "Test Case:15", Baseline "TestCases_15.mat"
      Test Case:16: ExternalInput "Test Case:16", Baseline "TestCases_16.mat"
      Test Case:17: ExternalInput "Test Case:17", Baseline "TestCases_17.mat"
      Test Case:18: ExternalInput "Test Case:18", Baseline "TestCases_18.mat"
      Test Case:19: ExternalInput "Test Case:19", Baseline "TestCases_19.mat"
      Test Case:20: ExternalInput "Test Case:20", Baseline "TestCases_20.mat"
      Test Case:21: ExternalInput "Test Case:21", Baseline "TestCases_21.mat"
      Test Case:22: ExternalInput "Test Case:22", Baseline "TestCases_22.mat"
      Test Case:23: ExternalInput "Test Case:23", Baseline "TestCases_23.mat"
      Test Case:24: ExternalInput "Test Case:24", Baseline "TestCases_24.mat"
      Test Case:25: ExternalInput "Test Case:25", Baseline "TestCases_25.mat"
      Test Case:26: ExternalInput "Test Case:26", Baseline "TestCases_26.mat"
      Test Case:27: ExternalInput "Test Case:27", Baseline "TestCases_27.mat"
      Test Case:28: ExternalInput "Test Case:28", Baseline "TestCases_28.mat"
      Test Case:29: ExternalInput "Test Case:29", Baseline "TestCases_29.mat"
      Test Case:30: ExternalInput "Test Case:30", Baseline "TestCases_30.mat"
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