% Requirement links of WDGBrakingLogic_Test.mldatx (R2021a)

item 1 verifies SSRS.slreqx#95: HLF7.2.4.2: Partial Braking Level 1
item 1 verifies SSRS.slreqx#96: HLF7.2.4.3: Partial Braking Level 2
item 1 verifies SSRS.slreqx#97: HLF7.2.4.4: Full Braking
item 1 verifies SSRS.slreqx#98: HLF7.2.4.5: Idle state