test file "HighwayLaneFollowingControllerMetricAssessments"

suite "Test Scenarios"
  setup callback:
    visionVariant = "VisionProcessingAlgorithm";
    % visionVariant = "ProbabilisticDetectionSensor";

  case "scenario_LF_01_Straight_RightLane" [simulation]
    model HighwayLaneFollowingController, harness HighwayLaneFollowingControllerAssessment
    pre-load callback:
      evalin('base', 'clear;');
    post-load callback:
      [scenario, assessment] = scenario_LF_01_Straight_RightLane();
      vehSim3D=  vehicleSim3DParams(scenario);
      egoVehDyn = egoVehicleDynamicsParams(scenario);
      v_set=  egoVehDyn.VLong0;

      %%
      blkSim3DConfig = "HighwayLaneFollowingControllerAssessment/Simulation3DScenario/Simulation3DSceneConfiguration";
      setSim3DSceneDesc(blkSim3DConfig, scenario);
      init_simulation_vars;
    cleanup callback:
      evalin('base', 'clear;');

  case "scenario_LF_02_Straight_LeftLane" [simulation]
    model HighwayLaneFollowingController, harness HighwayLaneFollowingControllerAssessment
    pre-load callback:
      evalin('base', 'clear;');
    post-load callback:
      [scenario, assessment] = scenario_LF_02_Straight_LeftLane();
      vehSim3D=  vehicleSim3DParams(scenario);
      egoVehDyn = egoVehicleDynamicsParams(scenario);
      v_set=  egoVehDyn.VLong0;

      %%
      blkSim3DConfig = "HighwayLaneFollowingControllerAssessment/Simulation3DScenario/Simulation3DSceneConfiguration";
      setSim3DSceneDesc(blkSim3DConfig, scenario);
      init_simulation_vars;
    cleanup callback:
      evalin('base', 'clear;');

  case "scenario_LF_03_Curve_LeftLane" [simulation]
    model HighwayLaneFollowingController, harness HighwayLaneFollowingControllerAssessment, start time 0, stop time 18
    pre-load callback:
      evalin('base', 'clear;');
    post-load callback:
      [scenario, assessment] = scenario_LF_03_Curve_LeftLane();
      vehSim3D=  vehicleSim3DParams(scenario);
      egoVehDyn = egoVehicleDynamicsParams(scenario);
      v_set=  egoVehDyn.VLong0;

      %%
      blkSim3DConfig = "HighwayLaneFollowingControllerAssessment/Simulation3DScenario/Simulation3DSceneConfiguration";
      setSim3DSceneDesc(blkSim3DConfig, scenario);
      init_simulation_vars;
    cleanup callback:
      evalin('base', 'clear;');

  case "scenario_LF_04_Curve_RightLane" [simulation]
    model HighwayLaneFollowingController, harness HighwayLaneFollowingControllerAssessment, start time 0, stop time 18
    pre-load callback:
      evalin('base', 'clear;');
    post-load callback:
      [scenario, assessment] = scenario_LF_04_Curve_RightLane();
      vehSim3D=  vehicleSim3DParams(scenario);
      egoVehDyn = egoVehicleDynamicsParams(scenario);
      v_set=  egoVehDyn.VLong0;

      %%
      blkSim3DConfig = "HighwayLaneFollowingControllerAssessment/Simulation3DScenario/Simulation3DSceneConfiguration";
      setSim3DSceneDesc(blkSim3DConfig, scenario);
      init_simulation_vars;
    cleanup callback:
      evalin('base', 'clear;');

  case "scenario_LFACC_01_Curve_DecelTarget" [simulation]
    model HighwayLaneFollowingController, harness HighwayLaneFollowingControllerAssessment, start time 0, stop time 25
    pre-load callback:
      evalin('base', 'clear;');
    post-load callback:
      [scenario, assessment] = scenario_LFACC_01_Curve_DecelTarget();
      vehSim3D=  vehicleSim3DParams(scenario);
      egoVehDyn = egoVehicleDynamicsParams(scenario);
      v_set=  egoVehDyn.VLong0;

      %%
      blkSim3DConfig = "HighwayLaneFollowingControllerAssessment/Simulation3DScenario/Simulation3DSceneConfiguration";
      setSim3DSceneDesc(blkSim3DConfig, scenario);
      init_simulation_vars;
    cleanup callback:
      evalin('base', 'clear;');

  case "scenario_LFACC_02_Curve_AutoRetarget" [simulation]
    model HighwayLaneFollowingController, harness HighwayLaneFollowingControllerAssessment, start time 0, stop time 18
    pre-load callback:
      evalin('base', 'clear;');
    post-load callback:
      [scenario, assessment] = scenario_LFACC_02_Curve_AutoRetarget();
      vehSim3D=  vehicleSim3DParams(scenario);
      egoVehDyn = egoVehicleDynamicsParams(scenario);
      v_set=  egoVehDyn.VLong0;

      %%
      blkSim3DConfig = "HighwayLaneFollowingControllerAssessment/Simulation3DScenario/Simulation3DSceneConfiguration";
      setSim3DSceneDesc(blkSim3DConfig, scenario);
      init_simulation_vars;
    cleanup callback:
      evalin('base', 'clear;');

  case "scenario_LFACC_03_Curve_StopnGo" [simulation]
    model HighwayLaneFollowingController, harness HighwayLaneFollowingControllerAssessment, start time 0, stop time 32
    pre-load callback:
      evalin('base', 'clear;');
    post-load callback:
      [scenario, assessment] = scenario_LFACC_03_Curve_StopnGo();
      vehSim3D=  vehicleSim3DParams(scenario);
      egoVehDyn = egoVehicleDynamicsParams(scenario);
      v_set=  egoVehDyn.VLong0;

      %%
      blkSim3DConfig = "HighwayLaneFollowingControllerAssessment/Simulation3DScenario/Simulation3DSceneConfiguration";
      setSim3DSceneDesc(blkSim3DConfig, scenario);
      init_simulation_vars;
    cleanup callback:
      evalin('base', 'clear;');

  case "scenario_LFACC_04_Curve_CutInOut" [simulation]
    model HighwayLaneFollowingController, harness HighwayLaneFollowingControllerAssessment, start time 0, stop time 25
    pre-load callback:
      evalin('base', 'clear;');
    post-load callback:
      [scenario, assessment] = scenario_LFACC_04_Curve_CutInOut();
      vehSim3D=  vehicleSim3DParams(scenario);
      egoVehDyn = egoVehicleDynamicsParams(scenario);
      v_set=  egoVehDyn.VLong0;

      %%
      blkSim3DConfig = "HighwayLaneFollowingControllerAssessment/Simulation3DScenario/Simulation3DSceneConfiguration";
      setSim3DSceneDesc(blkSim3DConfig, scenario);
      init_simulation_vars;
    cleanup callback:
      evalin('base', 'clear;');

  case "scenario_LFACC_05_Curve_CutInOut_TooClose" [simulation]
    model HighwayLaneFollowingController, harness HighwayLaneFollowingControllerAssessment, stop time 25
    pre-load callback:
      evalin('base', 'clear;');
    post-load callback:
      [scenario, assessment] = scenario_LFACC_05_Curve_CutInOut_TooClose();
      vehSim3D=  vehicleSim3DParams(scenario);
      egoVehDyn = egoVehicleDynamicsParams(scenario);
      v_set=  egoVehDyn.VLong0;

      %%
      blkSim3DConfig = "HighwayLaneFollowingControllerAssessment/Simulation3DScenario/Simulation3DSceneConfiguration";
      setSim3DSceneDesc(blkSim3DConfig, scenario);
      init_simulation_vars;
    cleanup callback:
      evalin('base', 'clear;');

  case "scenario_LFACC_06_Straight_StopandGoLeadCar" [simulation]
    model HighwayLaneFollowingController, harness HighwayLaneFollowingControllerAssessment, start time 0, stop time 25
    pre-load callback:
      evalin('base', 'clear;');
    post-load callback:
      [scenario, assessment] = scenario_LFACC_06_Straight_StopandGoLeadCar();
      vehSim3D=  vehicleSim3DParams(scenario);
      egoVehDyn = egoVehicleDynamicsParams(scenario);
      v_set=  egoVehDyn.VLong0;

      %%
      blkSim3DConfig = "HighwayLaneFollowingControllerAssessment/Simulation3DScenario/Simulation3DSceneConfiguration";
      setSim3DSceneDesc(blkSim3DConfig, scenario);
      init_simulation_vars;
    cleanup callback:
      evalin('base', 'clear;');